# Grasshopper definition youyan.gh (Grasshopper 1.0.9)

trigger = Trigger(Interval=10, TimerInterval=10, Target=c_script)  # disabled
c_script = CSharpScript()  # -> out, a
# ---------- c_script: C# ----------
// Grasshopper Script Instance
#region Usings
using System;
using System.Linq;
using System.Collections;
using System.Collections.Generic;
using System.Drawing;

using Rhino;
using Rhino.Geometry;

using Grasshopper;
using Grasshopper.Kernel;
using Grasshopper.Kernel.Data;
using Grasshopper.Kernel.Types;
#endregion

public class Script_Instance : GH_ScriptInstance
{
    #region Notes
    /* 
      Members:
        RhinoDoc RhinoDocument
        GH_Document GrasshopperDocument
        IGH_Component Component
        int Iteration

      Methods (Virtual & overridable):
        Print(string text)
        Print(string format, params object[] args)
        Reflect(object obj)
        Reflect(object obj, string method_name)
    */
    #endregion

    public static List<Point3d> points = new List<Point3d>();
    public static double t = 0;
    ScatterPoints sc = new ScatterPoints();

    private void RunScript(ref object a)
    {
        points.Clear();
        a = sc.GeneratePoints();
    }

    public class ScatterPoints
    {
        public List<Point3d> GeneratePoints(int numPoints = 20000)
        {
            
            double[] x = new double[numPoints];
            double[] y = new double[numPoints];
            double[] k = new double[numPoints];
            double[] e = new double[numPoints];
            double[] o = new double[numPoints];

            // 计算 x 和 y 数组
            for (int i = 0; i < numPoints; i++)
            {
                x[i] = i % 100; // mod(i, 100)
                y[i] = Math.Floor(i / 100.0); // floor(i / 100)
                k[i] = x[i] / 4 - 12.5;
                e[i] = y[i] / 9 + 5;
                o[i] = Math.Sqrt(k[i] * k[i] + e[i] * e[i]) / 9; // vecnorm([k; e]) / 9
            }

            t += Math.PI / 90;

            // 计算各个点的位置
            for (int i = 0; i < numPoints; i++)
            {
                double q = x[i] + 99 + Math.Tan(1.0 / k[i]) + o[i] * k[i] * (Math.Cos(e[i] * 9) / 4 + Math.Cos(y[i] / 2)) * Math.Sin(o[i] * 4 - t);
                double c = o[i] * e[i] / 30 - t / 8;
                double xData = (q * 0.7 * Math.Sin(c)) + (9 * Math.Cos(y[i] / 19 + t)) + 200;
                double yData = 200 + (q / 2 * Math.Cos(c));

                points.Add(new Point3d(xData, yData, 0)); // Z 坐标设为 0
            }

            return points; // 返回生成的点
        }
    }

}
# ---------- end c_script ----------
